# Grasshopper definition JSON Example.ghx (Grasshopper 0.9.70)
# plug-ins: ghJSON

panel = Panel("""{ "store": {
    "book": [ 
      { "category": "reference",
        "author": "Nigel Rees",
        "title": "Sayings of the Century",
        "price": 8.95
      },
      { "category": "fiction",
        "author": "Evelyn Waugh",
        "title": "Sword of Honour",
        "price": 12.99
      },
      { "category": "fiction",
        "author": "Herman Melville",
        "title": "Moby Dick",
        "isbn": "0-553-21311-3",
        "price": 8.99
      },
      { "category": "fiction",
        "author": "J. R. R. Tolkien",
        "title": "The Lord of the Rings",
        "isbn": "0-395-19395-8",
        "price": 22.99
      }
    ],
    "bicycle": {
      "color": "red",
      "price": 19.95
    }
  }
}""")
fromjson = FromJSON(JSON=panel)
jpath = JPath(JObject=fromjson, JPathQuery="$.store.book[*].title")
panel_2 = Panel(fromjson)
panel_3 = Panel(jpath)
